# Grasshopper definition iridecencePhenomenon.gh (Grasshopper 1.0.5)
# plug-ins: Mesh Pipe

panel = Panel("""iridecencePhenomenon
february 2019
adrien@thr34d5.org""")

# ---- group: parameters
number_of_media_layers = Slider(50, range=0..100)
media_layers_thickness = Slider(0.01, range=0..1)
media_brep = Brep(<brep referenced from the Rhino model>)
rays_number = Slider(500, range=0..1000)

# ----
number_slider = Slider(100, range=0..1000)
number_slider_2 = Slider(10, range=0..10)
pt = ConstructPoint(XCoordinate=0, YCoordinate=0, ZCoordinate=0)
pt_2 = ConstructPoint(XCoordinate=number_slider, YCoordinate=number_slider, ZCoordinate=number_slider)
box = Box2Pt(PointA=pt, PointB=pt_2, Plane=PlaneXY(0, 0, 0))
neg = Negative(Value=number_slider_2)
vec = VectorXYZ(XComponent=Slider(10, range=0..10), YComponent=number_slider_2, ZComponent=neg)  # -> Vector, Length
pop3d = Populate3D(Region=box, Count=rays_number, Seed=1)  # -> flatten(Population)
line = LineSDL(Start=pop3d, Direction=vec.Vector, Length=Slider(347, range=0..1000))  # -> flatten(Line)

# ---- group: media design
number_slider_3 = Slider(1000, range=0..1000)
custom_mesh_settings = SettingsCustom(
    StitchSeams=True,
    SimplePlanes=False,
    Refine=True,
    MinCount=number_slider_3,
    MaxCount=number_slider_3,
    AspectRatio=20,
    MaxDistance=0,
    MaxAngle=20,
    MinEdge=0,
    MaxEdge=0)
series = Series(Start=0, Step=media_layers_thickness, Count=number_of_media_layers)
mesh = MeshBrep(Brep=media_brep, Settings=custom_mesh_settings)
Z = UnitZ(Factor=series)
move = Move(Geometry=mesh, Motion=Z)  # -> Geometry, Transform

# ---- group: iridescence spectrum
series_2 = Series(Start=0, Step=1, Count=number_of_media_layers)
bnd = Bounds(Numbers=series_2)
dom = ConstructDomain(DomainStart=Slider(0, range=0..100), DomainEnd=Slider(1, range=0..1))
remap = RemapNumbers(Value=series_2, Source=bnd, Target=dom)  # -> Mapped, Clipped
pt_3 = ConstructPoint(XCoordinate=remap.Mapped, YCoordinate=0, ZCoordinate=0)
image = ImageSampler(
    pt_3,
    FilePath="C:\Users\adrien.rigobello\Desktop\WhatsApp Image 2019-02-08 at 14.24.0vefqdv7.jpeg",
    Filter="Colour",
    Interpolate=False,
    Umax=1,
    Umin=0,
    Vmax=1,
    Vmin=0,
    Wrap=1)

# ---- group: emission
amp = Amplitude(Vector=vec.Vector, Amplitude=Slider(37, range=0..1000))
vdis = VectorDisplay(Anchor=pop3d, Vector=amp)
preview = CustomPreview(Geometry=line, Material=ColourSwatch(SwatchColor=RGB(255, 255, 255)))

# ---- group: media
item = ListItem(List=move.Geometry, Index=0, Wrap=True)
medges = MeshEdges(Mesh=item)  # -> NakedEdges, InteriorEdges, NonManifoldEdges
preview_2 = CustomPreview(Geometry=[medges.InteriorEdges, medges.NakedEdges], Material=ColourSwatch(SwatchColor=RGB(0, 255, 0)))

# ---- group: reflection planes generation
demesh = DeconstructMesh(Mesh=move.Geometry)  # -> Vertices, Faces, Colours, Normals
deface = DeconstructFace(Face=demesh.Faces)  # -> CornerA, CornerB, CornerC, CornerD
item_2 = ListItem(List=demesh.Vertices, Index=deface.CornerA, Wrap=True)
item_3 = ListItem(List=demesh.Vertices, Index=deface.CornerC, Wrap=True)
pdecon = Deconstruct(Point=item_2)  # -> XComponent, YComponent, ZComponent
pdecon_2 = Deconstruct(Point=item_3)  # -> XComponent, YComponent, ZComponent
facen = FaceNormals(Mesh=move.Geometry)  # -> Centers, Normals
addition = Addition(A=pdecon.XComponent, B=pdecon_2.XComponent)
addition_2 = Addition(A=pdecon.YComponent, B=pdecon_2.YComponent)
addition_3 = Addition(A=pdecon.ZComponent, B=pdecon_2.ZComponent)
division = Division(A=addition, B=2)
division_2 = Division(A=addition_2, B=2)
division_3 = Division(A=addition_3, B=2)
pt_4 = ConstructPoint(XCoordinate=division, YCoordinate=division_2, ZCoordinate=division_3)
line_2 = LineSDL(Start=facen.Centers, Direction=facen.Normals, Length=1)
neg_2 = Negative(Value=Slider(45, range=0..100))
rad = Radians(Degrees=neg_2)
lnpt = LinePt(Line=line_2, Point=pt_4)
pl = PlaneNormal(Origin=facen.Centers, ZAxis=facen.Normals)
rotate = Rotate(Geometry=lnpt, Angle=rad, Plane=pl)  # -> simplify(Geometry), Transform

# ---- group: phenomenon
graft = GraftTree(Tree=move.Geometry, IncludeEmptyLists=True, IncludeNullItems=True)  # -> simplify(Tree)
partition = PartitionList(List=line, Size=number_of_media_layers)  # -> simplify(Chunks)
path_mapper = PathMapper(graft, source="{A}", target="{A+1}")
flip = FlipMatrix(Data=partition)
mcx = MeshCurve(Mesh=path_mapper, Curve=flip)  # -> Points, Faces
path_mapper_2 = PathMapper(mcx.Faces, source="{A;B}", target="{A-1}")
item_4 = ListItem(List=rotate.Geometry, Index=path_mapper_2, Wrap=True)
mirror = Mirror(Geometry=flip, Plane=simplify(item_4))  # -> Geometry, Transform

# ---- group: trim resulting lines
mcx_2 = MeshCurve(Mesh=item, Curve=mirror.Geometry)  # -> simplify(flatten(Points)), Faces
end = EndPoints(Curve=mirror.Geometry)  # -> Start, End
ln = Line(StartPoint=mcx_2.Points, EndPoint=flatten(end.Start))
unflatten = UnflattenTree(Tree=ln, Guide=mirror.Geometry)

# ---- group: reflection
preview_3 = CustomPreview(Geometry=simplify(unflatten), Material=simplify(graft(image)))

# ---- group: viewer effect
number_slider_4 = Slider(0.744, range=0..1)
scale = Scale(Geometry=ln, Center=mcx_2.Points, Factor=Slider(0.01, range=0..1))  # -> Geometry, Transform
swatch = ColourSwatch(SwatchColor=RGB(0, 0, 0))
mpipe = MeshPipe(Curve=scale.Geometry, Radius=number_slider_4, Accuracy=0.2, Rotation=0, Segments=10, Caps=Slider(0, range=0..100))
scale_2 = Scale(Geometry=ln, Center=mcx_2.Points, Factor=Slider(0.005, range=0..1))  # -> Geometry, Transform
multiplication = Multiplication(A=number_slider_4, B=Slider(0.9, range=0..1))
mpipe_2 = MeshPipe(Curve=scale_2.Geometry, Radius=multiplication, Accuracy=0.2, Rotation=0, Segments=10, Caps=Slider(1, range=0..10))
unflatten_2 = UnflattenTree(Tree=mpipe_2, Guide=mirror.Geometry)

mcol = MeshColours(Mesh=mpipe, Colours=swatch)
mcol_2 = MeshColours(Mesh=unflatten_2, Colours=graft(image))
